# Grasshopper definition My GH Script.gh (Grasshopper 0.9.76)
# plug-ins: Python Interpreter

panel = Panel("C:\Users\Christian\Miniconda3\envs\livestock_env\python.exe")
my_component = MyComponent(MyInput="Hello_World", ResultFolder="C:\Users\Christian\Desktop\Test_Livestock", Run=Toggle(False))  # -> readMe, MyResult
#   port ResultFolder: Folder where the result files should be saved
#   port Run: Run the component
#   port readMe: In case of any errors, it will be shown here.
# ---------- my_component: Python ----------
from livestock3d.components import MyComponent

comp = MyComponent(ghenv)
comp.config()
comp.run_checks(MyInput, ResultFolder, Run)
comp.run()

MyResult = comp.results
# ---------- end my_component ----------
python_executor = PythonExecutor(PythonPath=panel)  # -> readMe
#   port PythonPath: Path to python.exe
#   port readMe: In case of any errors, it will be shown here.
# ---------- python_executor: Python ----------
from livestock3d.components import PythonExecutor

comp = PythonExecutor(ghenv)
comp.config()
comp.run_checks(str(PythonPath))
comp.run()
# ---------- end python_executor ----------
panel_2 = Panel(python_executor)
panel_3 = Panel(my_component.MyResult)
